# Grasshopper definition example.gh (Grasshopper 1.0.7)
# plug-ins: SWAAN

pipeline = GeometryPipeline(
    GroupByLayer=False,
    GroupByType=False,
    IncludeHidden=True,
    IncludeLocked=True,
    LayerFilter="*",
    NameFilter="*",
    SublayerFiltering=True,
    TypeFilter=4)
an = SWAAN(
    Vertical_offset=Toggle(False),
    MarshallingSignalParameter=pipeline,
    Mesh_formation=Toggle(False),
    Smoothness=Slider(1, range=1..50))  # -> Elevated_contours, Final_mesh
